# Grasshopper definition annotation_test.gh (Grasshopper 1.0.7)
# plug-ins: GrasshopperPRT

colour = ColourPicker(PickedColour=RGB(255, 105, 180))

# ---- group: numbers
number_slider = Slider(2, range=0..10)
num = Number()

# ----
path = FilePath("C:\Users\lor11212\Documents\Rhino\rhino-plugin-prototype\TestCases\annotations_test.rpk")
rec = Rectangle({Plane=PlaneXY(2, 13, 0), Size=Domain2(u=-13..13, v=-19..19)})
ghprt = GrasshopperPRT(
    PathToRPK=path,
    InitialShapes=rec,
    DefaultColorChoice=colour,
    DefaultSetBack=number_slider,
    DefaultPyramidHeight=num,
    RPK_PATH="C:\Users\lor11212\Documents\Rhino\rhino-plugin-prototype\TestCases\annotations_test.rpk")  # -> GeneratedShapes, Materials, Reports
