# Grasshopper definition parthenon_test.gh (Grasshopper 1.0.7)
# plug-ins: GrasshopperPRT

panel = Panel("High")
srf = Surface(<surface referenced from the Rhino model>)
path = FilePath("C:\Users\lor11212\Documents\Rhino\rhino-plugin-prototype\parthenon.rpk")
srf_2 = Surface(<surface referenced from the Rhino model>)
path_2 = FilePath("C:\Users\lor11212\Documents\Rhino\rhino-plugin-prototype\complexpatterns_01.rpk")
num = Number(30)
ghprt = GrasshopperPRT(PathToRPK=path, InitialShapes=srf, DefaultGenerate_Roof=Toggle(True), DefaultNo_of_Steps=Slider(3, range=0..10))
ghprt_2 = GrasshopperPRT(PathToRPK=path_2, InitialShapes=srf_2)
panel_2 = Panel(ghprt)
srf_3 = Surface(<surface referenced from the Rhino model>)
path_3 = FilePath("C:\Users\lor11212\Documents\Rhino\rhino-plugin-prototype\Candler_Building.rpk")
ghprt_3 = GrasshopperPRT(PathToRPK=path_3, InitialShapes=srf_3)
