# Grasshopper definition report02_test.gh (Grasshopper 1.0.7)
# plug-ins: GrasshopperPRT

rec = Rectangle([{Plane=PlaneXY(-34, 29.5, 0), Size=Domain2(u=-15..15, v=-16.5..16.5)}, {Plane=PlaneXY(35, 30.5, 0), Size=Domain2(u=-19..19, v=-18.5..18.5)}])
path = FilePath("C:\Users\lor11212\Documents\Rhino\rhino-plugin-prototype\TestCases\reporting_03.rpk")
ghprt = GrasshopperPRT(PathToRPK=path, InitialShapes=rec)  # -> GeneratedShapes, Materials, Reports
cga_reports_display = GrasshopperPRTReports(Meshes=ghprt.GeneratedShapes, Reports=ghprt.Reports, ShapeIDFilter=Domain(-1.234321012e+308, -1.234321012e+308))  # -> ReportsLocation, ReportsDisplay, Reports
preview = CustomPreview(Geometry=ghprt.GeneratedShapes, Material=ghprt.Materials)
reports_outputs = GrasshopperPRTReportsOutput(Reports=cga_reports_display.Reports)  # -> ReportName, ShapeID, ReportValue
tag = TextTag3D(Location=cga_reports_display.ReportsLocation, Text=cga_reports_display.ReportsDisplay, Size=1, Justification=7)
